% Simulink data dictionary TdpRecoveryTypes.sldd
% references TdpTypes.sldd

RecoveryTeamBus = Simulink.Bus()
  basePhase: Enum: TdpTeamPhase
  phase: Enum: TdpTeamPhase
  chaser: double
  failed: boolean
  recovering: boolean
  releaseId: uint32
  handledFailureId: uint32
  ballKnown: boolean
  ballSource: double
  takeover: boolean
  releaseStamp: double
  healthTiming: boolean
  healthySince: double
  lastHealthyStamp: double
  cancelPending: boolean
  releaseDeadline: double
  failureReason: Enum: TdpV1Reason

V1HealthBus = Simulink.Bus()
  reason: Enum: TdpV1Reason
  ready: boolean
  stamp: double
  requestId: uint32
  activeId: uint32