% Simulink data dictionary TdpTypes.sldd

ActuatorBus = Simulink.Bus()
  seenId: uint32
  rejectedId: uint32
  active: boolean
  start: double
  target: double[1 2]
  speed: double
  feedback: Bus: FeedbackBus
  executions: uint32

BallBus = Simulink.Bus()
  x: double
  y: double
  vx: double
  vy: double

FeedbackBus = Simulink.Bus()
  requestId: uint32
  status: Enum: TdpStatus
  stamp: double

GeometryBus = Simulink.Bus()
  command: double[1 3]
  target: double[1 2]
  speed: double
  ready: boolean
  distance: double
  safe: boolean
  ballVisible: boolean
  running: boolean
  intent: Enum: TdpAction

IntentBus = Simulink.Bus()
  type: Enum: TdpAction
  target: double[1 2]
  heading: double
  speed: double
  role: Enum: TdpRole

ObservationBus = Simulink.Bus()
  selfIndex: double
  robots: Bus: RobotBus[1 8]
  robotValid: boolean[1 8]
  robotStamp: double[1 8]
  ball: Bus: BallBus
  ballValid: boolean
  ballStamp: double
  selfValid: boolean
  gameRunning: boolean
  allowKick: boolean
  tSim: double

RefereeBus = Simulink.Bus()
  t: double
  score: double[1 2]
  lastTouch: double
  pauseUntil: double
  msg: Enum: TdpEvent
  msgUntil: double
  shots: double[1 2]
  touchTime: double[1 2]

RequestBus = Simulink.Bus()
  requestId: uint32
  kind: Enum: TdpAction
  velocity: double[1 3]
  target: double[1 2]
  speed: double
  stamp: double
  validUntil: double

RobotBus = Simulink.Bus()
  team: double
  num: double
  isGK: boolean
  role: Enum: TdpRole
  x: double
  y: double
  th: double
  vxw: double
  vyw: double
  cool: double

WorldBus = Simulink.Bus()
  robots: Bus: RobotBus[1 8]
  ball: Bus: BallBus
  referee: Bus: RefereeBus
  actuator: Bus: ActuatorBus[1 8]
  active: boolean[1 8]
  lastCommands: double[8 3]
  lastKick: boolean
  kickCount: uint32