% Simulink data dictionary TdpV1Types.sldd
% references TdpTypes.sldd

V1TeamBus = Simulink.Bus()
  basePhase: Enum: TdpTeamPhase
  phase: Enum: TdpTeamPhase
  chaser: double
  failed: boolean
  recovering: boolean
  releaseId: uint32
  handledFailureId: uint32
  ballKnown: boolean
  ballSource: double
  takeover: boolean
  releaseStamp: double